# Grasshopper definition rammeprogram.gh (Grasshopper 0.9.76)
# plug-ins: Python Interpreter

crv = Curve([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])

explode = Explode(Curve=crv, Recursive=True)  # -> Segments, Vertices
eval = EvaluateCurve(Curve=reparameterize(explode.Segments), Parameter=0.5)  # -> Point, Tangent, Angle
sort_pt = SortPoints(Points=flatten(eval.Point))  # -> Points, Indices
tstat = TreeStatistics(Tree=eval.Point)  # -> Paths, Length, Count
item = ListItem(List=tstat.Paths, Index=sort_pt.Indices, Wrap=True)
branch = TreeBranch(Tree=explode.Segments, Path=item, MaintainPaths=False)
explode_2 = Explode(Curve=branch, Recursive=True)  # -> Segments, Vertices
eval_2 = EvaluateCurve(Curve=reparameterize(flatten(explode_2.Segments)), Parameter=0.5)  # -> Point, Tangent, Angle
sort_pt_2 = SortPoints(Points=flatten(explode_2.Vertices))  # -> Points, Indices
points = PointList(Points=eval_2.Point)
pdecon = Deconstruct(Point=sort_pt_2.Points)  # -> XComponent, YComponent, ZComponent
pt = ConstructPoint(XCoordinate=pdecon.XComponent, YCoordinate=pdecon.YComponent, ZCoordinate=0)
lng = ListLength(List=pt)
panel = Panel(sort_pt_2.Points)
cullpt = CullDuplicates(Points=pt, Tolerance=Slider(0.001, range=0..0.001), CullMode=3)  # -> Points, Indices, Valence
series = Series(Start=0, Step=1, Count=lng)
cull_i = CullIndex(List=series, Indices=cullpt.Indices, Wrap=True)
item_2 = ListItem(List=cull_i, Index=sort_pt_2.Indices, Wrap=True)
cp = ClosestPoint(Point=explode_2.Vertices, Cloud=cullpt.Points)  # -> ClosestPoint, CPIndex, Distance
partition = PartitionList(List=item_2, Size=2)
points_2 = PointList(Points=cullpt.Points)
item_3 = ListItem(List=cp.CPIndex, Index=0, Wrap=True)  # -> Item, Item1
pt_2 = ConstructPoint(XCoordinate=item_3.Item, YCoordinate=item_3.Item1, ZCoordinate=0)

crosssection_area = CrosssectionArea()
moment_of_inertia = MomentOfInertia()
e_modul = EModul()
expression = Expression(x=Slider(2.1, range=0..10), Expression="x*10^11")
panel_2 = Panel("""0,1,0
1,2,0
2,3,0
3,4,0
4,5,0
5,6,0
6,7,0
7,8,0
8,9,0
9,10,0
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""")
panel_3 = Panel("""0,20
10,20
20,20
30,20
40,20
50,20
60,20
70,20
80,20
90,20
100,20
110,20
120,20
0,0
10,5.23
20,9.51
30,12.84
40,15.21
50,16.64
60,17.12
70,16.64
80,15.21
90,12.84
100,9.51
110,5.23
120,0""")
num = Number(expression)
txt = Text(e_modul)
txt_2 = Text(moment_of_inertia)
txt_3 = Text(crosssection_area)
num_2 = Number(Slider(2e-06, range=0..1e-05))
num_3 = Number(Slider(0.001, range=0..0.001))
pt_3 = Point(panel_2)
pt_4 = Point(panel_3)
pdecon_2 = Deconstruct(Point=panel_2)  # -> XComponent, YComponent, ZComponent
panel_4 = Panel("""     14 11
14 2 0
                      14 6 0
                      26 1 0
                      26 2 0
                      1 2 0
                      7 1 0
                      13 2 0""")
python = PythonScript(Emodul=num, SecArea=num_3, Inertia=num_2)  # -> out, a
# ---------- python: Python ----------
print SecArea
if len(Emodul)==len(SecArea) and len(Emodul)==len(Inertia):
    material="";
    for i in range(len(Emodul)):
        material=material+"G("+(i+1)+",:)=["+Emodul+" "+SecArea+" "+Inertia+"];\n"
else:
    print "List lengths must have equal lengths"
# ---------- end python ----------
long = LongestList(ListA=txt, ListB=txt_3, ListC=txt_2, PaddingMode=2)  # -> ListA, ListB, ListC
int = Integer(pdecon_2.XComponent)
int_2 = Integer(pdecon_2.YComponent)
entwine = Entwine(FlattenInputs=True)
lng_2 = ListLength(List=pt_4)
xy = XYPlane(Origin=pt_4)
bbox = BoundingBox(Content=pt_4, Plane=PlaneXY(0, 0, 0), UnionBox=True)  # -> Box, Box_2
item_4 = ListItem(List=pt_4, Index=int, Wrap=True)
item_5 = ListItem(List=pt_4, Index=int_2, Wrap=True)
python_2 = PythonScript(topolist=pt_3, nodes=pt_4)  # -> out, elements; inputs topolist: list, nodes: list
# ---------- python_2: Python ----------
import rhinoscriptsyntax as rs
import scriptcontext
import Rhino
scriptcontext.doc = ghdoc
startpoint=[]
endpoint=[]
eleProp=[]
elements=[]

for topo in topolist:
    indices=str(rs.PointCoordinates(topo)).split(",")
    stpt=nodes[int(indices[0])]
    enpt=nodes[int(indices[1])]
    startpoint.append(stpt)
    endpoint.append(enpt)
    elements.append(rs.AddLine(stpt,enpt))
    #eleProp.append(nodes[indices[2]])
# ---------- end python_2 ----------
series_2 = Series(Start=0, Step=1, Count=lng_2)
crv_2 = Curve(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)
crv_3 = Curve(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)
crv_4 = Curve(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)
area = Area(Geometry=bbox.Box)  # -> Area, Centroid
series_3 = Series(Start=0, Step=1, Count=10)
ln = Line(StartPoint=item_4, EndPoint=item_5)
merge = Merge(Data1=crv_2, Data2=crv_3, Data3=crv_4)
panel_5 = Panel("""14,1
14,2
14,3
26,1
26,2
1,2
7,1
13,2""")
int_3 = Integer(series_2)
division = Division(A=area.Area, B=1000)
scale = Scale(Geometry=merge, Center=Point(0, 0, 0), Factor=division)  # -> Geometry, Transform
tag = TextTag3D(Location=pt_4, Text=int_3, Size=division, Justification=7)
python_3 = PythonScript(topolist=pt_2, nodes=cullpt.Points)  # -> out, elements; inputs topolist: list, nodes: list; same code as python_2
